# Grasshopper definition assignment2.gh (Grasshopper 1.0.7)

pt = Point(Point(0.6551805314, 113.6401177, 0))
pt_2 = Point(Point(0, 0, 0))
pt_3 = Point(Point(-111.3545629, 31.73585614, 0))
merge = Merge(Data1=pt_2, Data2=pt_3, Data3=pt)
random = Random(Range=Slider(0.3889, range=0.25..1), Number=1, Seed=2)
random_2 = Random(Range=Slider(0.8608, range=0.25..1), Number=1, Seed=2)
nurbs = NurbsCurve(Vertices=merge, Degree=2, Periodic=Toggle(False))  # -> Curve, Length, Domain
intcrv = Interpolate(Vertices=merge, Degree=Slider(3, range=0..3), Periodic=Toggle(False), KnotStyle=1)  # -> Curve, Length, Domain
random_3 = Random(Range=Slider(0.6431, range=0.3..0.95), Number=1, Seed=2)
eval = EvaluateCurve(Curve=reparameterize(intcrv.Curve), Parameter=random)  # -> Point, Tangent, Angle
vec = Vector(Vector(9.777349487, 0, 0))
pt_4 = Point(eval.Point)
eval_2 = EvaluateCurve(Curve=reparameterize(nurbs.Curve), Parameter=random_3)  # -> Point, Tangent, Angle
angle = Angle(VectorA=eval.Tangent, VectorB=vec)  # -> Angle, Reflex
reb = RebuildCurve(Curve=nurbs.Curve, Degree=Slider(3, range=1..3), Count=Slider(8, range=2..20), Tangents=False)
vec_2 = Vector(Vector(9.909188034, 0, 0))
eval_3 = EvaluateCurve(Curve=reparameterize(intcrv.Curve), Parameter=random_2)  # -> Point, Tangent, Angle
reb_2 = RebuildCurve(Curve=intcrv.Curve, Degree=Slider(3, range=1..3), Count=Slider(8, range=2..20), Tangents=False)
rectangle = Rectangle(Plane=pt_4, XSize=Domain(0, 2.6), YSize=Domain(-10, 10), Radius=0)  # -> Rectangle, Length
pt_5 = Point(eval_2.Point)
vec_3 = Vector(Vector(9.777349487, 0, 0))
angle_2 = Angle(VectorA=eval_2.Tangent, VectorB=vec_2)  # -> Angle, Reflex
rectangle_2 = Rectangle(Plane=pt_5, XSize=Domain(0, 2.6), YSize=Domain(10, -10), Radius=0)  # -> Rectangle, Length
pt_6 = Point(eval_3.Point)
angle_3 = Angle(VectorA=eval_3.Tangent, VectorB=vec_3)  # -> Angle, Reflex
rectangle_3 = Rectangle(Plane=pt_6, XSize=Domain(0, 2.6), YSize=Domain(-10, 10), Radius=0)  # -> Rectangle, Length
rotate = Rotate(Geometry=rectangle_2.Rectangle, Angle=angle_2.Angle, Plane=pt_5)  # -> Geometry, Transform
rotate_2 = Rotate(Geometry=rectangle.Rectangle, Angle=angle.Angle, Plane=pt_4)  # -> Geometry, Transform
rotate_3 = Rotate(Geometry=rectangle_3.Rectangle, Angle=angle_3.Angle, Plane=pt_6)  # -> Geometry, Transform
join = JoinCurves(Curves=[nurbs.Curve, intcrv.Curve], Preserve=False)
fillet = Fillet(Curve=join, Radius=2)
trim_with_regions = TrimWithRegions(Curve=fillet, Regions=[rotate.Geometry, rotate_3.Geometry, rotate_2.Geometry])  # -> Inside, Outside
trim_with_regions_2 = TrimWithRegions(Curve=[rotate_3.Geometry, rotate.Geometry, rotate_2.Geometry], Regions=join)  # -> Inside, Outside
join_curves = JoinCurves(Curves=[trim_with_regions.Outside, trim_with_regions_2.Inside], Preserve=False)
