# Grasshopper definition musicbox.gh (Grasshopper 1.0.7)

number_slider = Slider(3, range=0..10)
coords = ImportCoordinates(File="/Users/amoon/Desktop/HCDE533/final_project/spool/arirang_points.txt", Separator=",", XIndex=0, YIndex=1, ZIndex=2)
scale = Scale(Geometry=coords, Center=Point(0, 0, 0), Factor=Slider(5, range=0..10))  # -> Geometry, Transform
brep = Brep(<brep referenced from the Rhino model>)
move = Move(Geometry=brep, Motion=scale.Geometry)  # -> Geometry, Transform
